% Requirement links of Flight_Control.slx (R2025b)

block :19 implements HighLevelReqs.slreqx#6: HLR_2: Hydraulic Actuator Feedback
block :20 implements HighLevelReqs.slreqx#6: HLR_2: Hydraulic Actuator Feedback
block :21 implements HighLevelReqs.slreqx#6: HLR_2: Hydraulic Actuator Feedback
block :22 implements HighLevelReqs.slreqx#5: HLR_1: Pilot Input Signal Processing
block :23 implements HighLevelReqs.slreqx#5: HLR_1: Pilot Input Signal Processing
block :24 implements HighLevelReqs.slreqx#5: HLR_1: Pilot Input Signal Processing
block :25 implements HighLevelReqs.slreqx#14: HLR_10: AHRS Input Signal Processing
block :26 implements HighLevelReqs.slreqx#14: HLR_10: AHRS Input Signal Processing
block :27 implements HighLevelReqs.slreqx#14: HLR_10: AHRS Input Signal Processing
block :31 implements HighLevelReqs.slreqx#8: HLR_4: Hydraulic Actuator Loop Control
block :32 implements HighLevelReqs.slreqx#8: HLR_4: Hydraulic Actuator Loop Control
block :33 implements HighLevelReqs.slreqx#8: HLR_4: Hydraulic Actuator Loop Control
block :34 implements HighLevelReqs.slreqx#8: HLR_4: Hydraulic Actuator Loop Control
block :35 implements HighLevelReqs.slreqx#9: HLR_5: Multi-Variable Inner Loop Control
block :36 implements HighLevelReqs.slreqx#10: HLR_6: Pitch Outer Loop Control
block :36 implements HighLevelReqs.slreqx#11: HLR_7: Roll Outer Loop Control
block :36 implements HighLevelReqs.slreqx#12: HLR_8: Yaw Rate Outer Loop Control
block :37 implements HighLevelReqs.slreqx#13: HLR_9: AHRS Validity Check
block :37 implements HighLevelReqs.slreqx#15: HLR_11: AHRS Voting for Triple Sensors
block :37 implements HighLevelReqs.slreqx#16: HLR_12: AHRS Voting for Dual Sensors
block :37 implements HighLevelReqs.slreqx#17: HLR_13: AHRS Usage of Single Sensor
block :37 implements HighLevelReqs.slreqx#18: HLR_14: AHRS Usage of No Sensor
block :39 implements HighLevelReqs.slreqx#8: HLR_4: Hydraulic Actuator Loop Control
block :39 implements HighLevelReqs.slreqx#9: HLR_5: Multi-Variable Inner Loop Control
block :40 implements HighLevelReqs.slreqx#8: HLR_4: Hydraulic Actuator Loop Control
block :40 implements HighLevelReqs.slreqx#9: HLR_5: Multi-Variable Inner Loop Control
block :41 implements HighLevelReqs.slreqx#8: HLR_4: Hydraulic Actuator Loop Control
block :41 implements HighLevelReqs.slreqx#9: HLR_5: Multi-Variable Inner Loop Control
block :42 implements HighLevelReqs.slreqx#5: HLR_1: Pilot Input Signal Processing
block :43 implements HighLevelReqs.slreqx#5: HLR_1: Pilot Input Signal Processing
block :44 implements HighLevelReqs.slreqx#5: HLR_1: Pilot Input Signal Processing
block :45 implements HighLevelReqs.slreqx#6: HLR_2: Hydraulic Actuator Feedback
block :46 implements HighLevelReqs.slreqx#6: HLR_2: Hydraulic Actuator Feedback
block :47 implements HighLevelReqs.slreqx#6: HLR_2: Hydraulic Actuator Feedback
block :48 implements HighLevelReqs.slreqx#7: HLR_3: Hydraulic Actuator Drive
block :49 implements HighLevelReqs.slreqx#7: HLR_3: Hydraulic Actuator Drive
block :50 implements HighLevelReqs.slreqx#7: HLR_3: Hydraulic Actuator Drive
block :51 implements HighLevelReqs.slreqx#5: HLR_1: Pilot Input Signal Processing
block :52 implements HighLevelReqs.slreqx#5: HLR_1: Pilot Input Signal Processing
block :53 implements HighLevelReqs.slreqx#5: HLR_1: Pilot Input Signal Processing
block :54 implements HighLevelReqs.slreqx#6: HLR_2: Hydraulic Actuator Feedback
block :55 implements HighLevelReqs.slreqx#6: HLR_2: Hydraulic Actuator Feedback
block :56 implements HighLevelReqs.slreqx#6: HLR_2: Hydraulic Actuator Feedback
block :60 implements HighLevelReqs.slreqx#7: HLR_3: Hydraulic Actuator Drive
block :61 implements HighLevelReqs.slreqx#7: HLR_3: Hydraulic Actuator Drive
block :62 implements HighLevelReqs.slreqx#7: HLR_3: Hydraulic Actuator Drive
block :67 implements HighLevelReqs.slreqx#6: HLR_2: Hydraulic Actuator Feedback
block :68 implements HighLevelReqs.slreqx#6: HLR_2: Hydraulic Actuator Feedback
block :69 implements HighLevelReqs.slreqx#6: HLR_2: Hydraulic Actuator Feedback