% Simulink data dictionary DD_InnerLoop_Control.sldd
% references csSingleInstance.sldd

phiFq = Simulink.Parameter(40, DataType="double")  % Roll-off frequency for roll correction.
rFq = Simulink.Parameter(40, DataType="double")  % Roll-off frequency for yaw rate correction.
thetaFq = Simulink.Parameter(40, DataType="double")  % Roll-off frequency for pitch correction.
fbLoopGain = Simulink.Parameter([2.211 -0.31 -0.00336 0.7854 -0.01518; -0.1923 -1.291 0.0182 -0.08502 -0.1195; -0.01936 -0.01205 -1.895 -0.004121 0.06797], DataType="double")  % AHRS feedback loop gain.