% Simulink data dictionary bus_types.sldd

AHRS_Bus = Simulink.Bus()
  valid: boolean, Min=0, Max=1
  theta: double, Min=-90, Max=90
  phi: double, Min=-180, Max=180
  r: double, Min=-60, Max=60
  q: double, Min=-60, Max=60
  p: double, Min=-60, Max=60